# Grasshopper definition New FC.gh (Grasshopper 1.0.7)

length = GetNumber(Slider(20, range=0..100), AtLeast=1, AtMost=1, Maximum=1.797693135e+308, Minimum=-1.797693135e+308, TreeAccess=False)
count = GetNumber(Slider(20, range=0..100), AtLeast=1, AtMost=1, Maximum=1.797693135e+308, Minimum=-1.797693135e+308, TreeAccess=False)
spacing = GetNumber(Slider(1, range=0..1), AtLeast=1, AtMost=1, Maximum=1.797693135e+308, Minimum=-1.797693135e+308, TreeAccess=False)
Y = UnitY(Factor=1)
line = LineSDL(Start="0,0,0", Direction=Y, Length=length)
series = Series(Start=spacing, Step=spacing, Count=count)
pt2y = GetNumber(Slider(18, range=0..20), AtLeast=1, AtMost=1, Maximum=1.797693135e+308, Minimum=-1.797693135e+308, TreeAccess=False)
pt2z = GetNumber(Slider(0, range=0..10), AtLeast=1, AtMost=1, Maximum=1.797693135e+308, Minimum=-1.797693135e+308, TreeAccess=False)
pt2x = GetNumber(Slider(16, range=0..20), AtLeast=1, AtMost=1, Maximum=1.797693135e+308, Minimum=-1.797693135e+308, TreeAccess=False)
pt1y = GetNumber(Slider(10, range=0..20), AtLeast=1, AtMost=1, Maximum=1.797693135e+308, Minimum=-1.797693135e+308, TreeAccess=False)
pt1z = GetNumber(Slider(0, range=0..10), AtLeast=1, AtMost=1, Maximum=1.797693135e+308, Minimum=-1.797693135e+308, TreeAccess=False)
pt1x = GetNumber(Slider(4, range=0..20), AtLeast=1, AtMost=1, Maximum=1.797693135e+308, Minimum=-1.797693135e+308, TreeAccess=False)
X = UnitX(Factor=series)
move = Move(Geometry=line, Motion=X)  # -> Geometry, Transform
pt = ConstructPoint(XCoordinate=pt2x, YCoordinate=pt2y, ZCoordinate=pt2z)
pt_2 = ConstructPoint(XCoordinate=pt1x, YCoordinate=pt1y, ZCoordinate=pt1z)
divide = DivideCurve(Curve=move.Geometry, Count=count, Kinks=False)  # -> Points, Tangents, Parameters
merge = Merge(Data1=pt_2, Data2=pt)
cp = ClosestPoint(Point=divide.Points, Cloud=merge)  # -> ClosestPoint, CPIndex, Distance
division = Division(A=cp.Distance, B="2")
Z = UnitZ(Factor=division)
neg = Negative(Value=Z)
move_2 = Move(Geometry=divide.Points, Motion=neg)  # -> Geometry, Transform
pline = PolyLine(Vertices=move_2.Geometry, Closed=False)
pline_2 = PolyLine(Vertices=divide.Points, Closed=False)
end = EndPoints(Curve=pline_2)  # -> Start, End
end_2 = EndPoints(Curve=pline)  # -> Start, End
thickness = GetNumber(Slider(0.3, range=0.1..0.9), AtLeast=1, AtMost=1, Maximum=1.797693135e+308, Minimum=-1.797693135e+308, TreeAccess=False)
ln = Line(StartPoint=end.End, EndPoint=end_2.End)
ln_2 = Line(StartPoint=end.Start, EndPoint=end_2.Start)
boundary = BoundarySurfaces(Edges=[pline_2, ln_2, pline, ln])
X_2 = UnitX(Factor=thickness)
extr = Extrude(Base=boundary, Direction=X_2)

# ---- group: RH_OUT:FC
brep = Brep(extr)

# ----
context_bake = ContextBake(Geometry=brep)
